# Dynamo custom node Walltype function as String.dyf (Dynamo 2.0.2.6826)
# category: TalismanNodes.Revit
# Returns a walltype function as String "Interior"

code_block = CodeBlock()
# ---------- code_block.designscript (3 lines) ----------
"Function";
["0","1","2","3","4","5","-1"];
["Interior","Exterior","Foundation","Retaining","Soffit","Core-shaft","Stacked?"];
# ----------------------------------------
byKeysValues = DesignScript.Builtin.Dictionary.ByKeysValues(keys=code_block.out1, values=code_block.out2)
Input = Input(: var[]..[])
getParameterValueByName = Element.GetParameterValueByName(element=Input, parameterName=code_block.out0)
string_from_object = FromObject(obj=getParameterValueByName)
length = String.Length(str=string_from_object)
number = DoubleInput(0)
gt = length > number
code_block_2 = CodeBlock { "-1"; }
if_ = If(test=gt, true=string_from_object, false=code_block_2)
valueAtKey = DesignScript.Builtin.Dictionary.ValueAtKey(dictionary=byKeysValues, key=if_)
Output = Output(valueAtKey)  # ""
